# Grasshopper definition daylight_guided_furniture_layout.gh (Grasshopper 1.0.7)

room = Curve(<curve referenced from the Rhino model>)
win = Curve([<curve referenced from the Rhino model> x2])
door = Curve(<curve referenced from the Rhino model>)

# ----
# 2. Furniture
#     types
bed = Curve(<curve referenced from the Rhino model>)
desk = Curve(<curve referenced from the Rhino model>)
lounge = Curve(<curve referenced from the Rhino model>)

# ----
# 1. Floor plan subdivision
explode = Explode(Curve=room, Recursive=True)  # -> Segments, Vertices
divlength = DivideLength(Curve=explode.Segments, Length="36")  # -> Points, Tangents, Parameters
hframe = HorizontalFrame(Curve=graft(explode.Segments), Parameter=divlength.Parameters)  # -> flatten(Frame)

# ----
# 3. Sides that snap on walls
explode_2 = Explode(Curve=bed, Recursive=True)  # -> reparameterize(Segments), Vertices
explode_3 = Explode(Curve=lounge, Recursive=True)  # -> reparameterize(Segments), Vertices
explode_4 = Explode(Curve=desk, Recursive=True)  # -> reparameterize(Segments), Vertices
hframe_2 = HorizontalFrame(Curve=explode_2.Segments, Parameter="0.5")
hframe_3 = HorizontalFrame(Curve=explode_3.Segments, Parameter="0.5")
hframe_4 = HorizontalFrame(Curve=explode_4.Segments, Parameter="0.5")
panel = Panel("""1
0""")
item = ListItem(List=hframe_4, Index="2", Wrap=True)
item_2 = ListItem(List=hframe_3, Index="3", Wrap=True)
cull_i = CullIndex(List=hframe_2, Indices=panel, Wrap=True)  # -> graft(List)

rect1 = Curve(<curve referenced from the Rhino model>)
rect2 = Curve(<curve referenced from the Rhino model>)
collision_detection = GhPythonScript(rect1=rect1, rect2=rect2)  # -> out, isCollided, a; inputs rect1: Curve, rect2: Curve
# ---------- collision_detection: Python ----------
import Rhino.Geometry as rh

center1 = rh.AreaMassProperties.Compute(rect1).Centroid
center2 = rh.AreaMassProperties.Compute(rect2).Centroid
# ---------- end collision_detection ----------

# ---- group: Position
number_slider = Slider(26, range=0..26)  # disabled

number_slider_2 = Slider(2, range=0..26)

number_slider_3 = Slider(26, range=0..26)  # disabled

# ----
# 4. Iterate arrangement combinations
orient = Orient(Geometry=desk, Source=item, Target=hframe)  # -> Geometry, Transform; disabled
orient_2 = Orient(Geometry=bed, Source=cull_i, Target=hframe)  # -> Geometry, Transform
orient_3 = Orient(Geometry=lounge, Source=item_2, Target=hframe)  # -> Geometry, Transform; disabled
bang = ExplodeTree(Data=orient.Geometry)  # disabled
bang_2 = ExplodeTree(Data=orient_2.Geometry)  # -> _0000, _0001, Branch2
bang_3 = ExplodeTree(Data=orient_3.Geometry)  # disabled
item_3 = ListItem(List=bang, Index=number_slider, Wrap=True)  # disabled
item_4 = ListItem(List=bang_2._0001, Index=number_slider_2, Wrap=True)
item_5 = ListItem(List=bang_3, Index=number_slider_3, Wrap=True)  # disabled

panel_2 = Panel(collision_detection.a)

# ----
# 5. Define Evaluation logic
area = Area(Geometry=win)  # -> Area, Centroid
area_2 = Area(Geometry=item_4)  # -> Area, Centroid
dist = Distance(PointA=area.Centroid, PointB=area_2.Centroid)
num_illuminance_proxy = Number(dist)

ln = Line(StartPoint=area.Centroid, EndPoint=area_2.Centroid)
